# Grasshopper definition Urban_thermal_comfort_rev6_IBPSA.gh (Grasshopper 1.0.7)
# plug-ins: Eddy3D, Human, Urbano, LadybugGrasshopper

# ----
# 0. Import surroundings from OpenStreetMap
panel = Panel("151.13109")

# ----
# Residential Buildings
panel_2 = Panel("2013::MidriseApartment::Apartment")
residentialsolids = Geometry()
buildingsolid = DFBuildingFromSolid(bldg_geo=flatten(residentialsolids), floor_to_floor="@3", name="ResidentialBldg", program=panel_2, run=Toggle(True))  # -> report, buildings; plug-in component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
simpleratiopar = DFSimpleWindowRatioParameters(ratio="0.3")  # -> win_par; plug-in component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
applyfacadepar = DFApplyFacadeParameters(df_obj=flatten(buildingsolid.buildings), win_par=simpleratiopar)  # -> report, df_obj; plug-in component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

# ----
# Edit Building UWG Properties
bldgvintages = HBBuildingVintages({"ASHRAE 90.1 2013  |  IECC 2015": "2013", "ASHRAE 90.1 2010  |  IECC 2012": "2010", "ASHRAE 90.1 2007  |  IECC 2009": "2007", "ASHRAE 90.1 2004  |  IECC 2006": "2004", "1980-2004 (CBECS)": "1980_2004", "Pre-1980 (CBECS)": "pre_1980"}, selected="ASHRAE 90.1 2010  |  IECC 2012")
buildinguwg = DFAssignBuildingUWGProperties(building=applyfacadepar.df_obj, vintage=bldgvintages, fr_canyon="1")  # -> report, building; plug-in component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

download_openstreetmap_osm = DownloadOpenStreetMapOSM(LeftBound=panel, RightBound="151.13450", TopBound="-33.96079", BottomBound="-33.96354", RunToggle=True)  # -> OSMQueryURL, OSMFilePath
import_osm_features = ImportOSMFeatures(OSMPathOrURL=download_openstreetmap_osm.OSMQueryURL, OSMFeatureType="building", Format="xml", ImportAltitude=False)  # -> Points, Metadata, UTMZone, TranslationVector
polyline = PolyLine(Vertices=import_osm_features.Points, Closed=False)
lookup = LookupMetadata(MetadataGeometry=import_osm_features.Metadata, SearchKey="building:levels")
python = GhPythonScript(levels=lookup, top_lvl_height=Slider(5, range=0..10), lvl_height=Slider(3.2, range=0..10))  # -> height; inputs levels: Int32
# ---------- python: Python ----------
if levels is not None: height = (levels-1)*lvl_height+top_lvl_height
# ---------- end python ----------
meta = CreateMetadata(KeysInMetadata="height", ValuesInMetadata=python)
mergemeta = MergeMetadata(Metadata=meta, Metadata_2=import_osm_features.Metadata)
create_building = CreateBuilding(BuildingCurve=polyline, Metadata=mergemeta)
# MIT License
# 
# Permission is hereby granted, free of charge, to any person obtaining a copy
# of this software and associated documentation files (the "Software"), to deal
# in the Software without restriction, including without limitation the rights
# to use, copy, modify, merge, publish, distribute, sublicense, and/or sell
# copies of the Software, and to permit persons to whom the Software is
# furnished to do so, subject to the following conditions:
# 
# The above copyright notice and this permission notice shall be included in all
# copies or substantial portions of the Software.
# 
# THE SOFTWARE IS PROVIDED "AS IS", WITHOUT WARRANTY OF ANY KIND, EXPRESS OR
# IMPLIED, INCLUDING BUT NOT LIMITED TO THE WARRANTIES OF MERCHANTABILITY,
# FITNESS FOR A PARTICULAR PURPOSE AND NONINFRINGEMENT. IN NO EVENT SHALL THE
# AUTHORS OR COPYRIGHT HOLDERS BE LIABLE FOR ANY CLAIM, DAMAGES OR OTHER
# LIABILITY, WHETHER IN AN ACTION OF CONTRACT, TORT OR OTHERWISE, ARISING FROM,
# OUT OF OR IN CONNECTION WITH THE SOFTWARE OR THE USE OR OTHER DEALINGS IN THE
# SOFTWARE.
number_slider = Slider(10, range=0..10)
inspect_building = InspectBuilding(Building=create_building, DefaultHeight=number_slider)  # -> Geometry, Metadata, Amenity, BuildingMesh

# ----
# Create Dragonfly Model
model = DFModel(buildings=flatten(buildinguwg.building))  # -> report, model; plug-in component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

# ----
# Edit District UWG Properties
terrain = Geometry(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)
traffic = DFTrafficParameters(watts_per_area="20")  # -> traffic; plug-in component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
terrain_2 = DFTerrain(terrain_geo=terrain)  # -> terrain; plug-in component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
modeluwg = DFAssignModelUWGProperties(model=model.model, terrain=terrain_2, traffic=traffic)  # -> report, model; plug-in component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
panel_3 = Panel(modeluwg.report)

# ----
# UWG Simulation
# Parameters
panel_4 = Panel("0.6")
boundarylayer = DFBoundaryLayerParameters()  # -> bnd_layer; plug-in component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
refepwpar = DFReferenceEPWParameters(veg_cover="0.95")  # -> epw_site; plug-in component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
vegetationpar = DFVegetationParameters(albedo=panel_4)  # -> veg_par; plug-in component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

# ----
# 1.1. Attach EPW file and morph UHI file
lb_falsestarttoggle = LBFalseStartToggle(False)
panel_5 = Panel("https://energyplus-weather.s3.amazonaws.com/southwest_pacific_wmo_region_5/AUS/AUS_NSW.Mascot-Sydney.Airport.947670_RMY/AUS_NSW.Mascot-Sydney.Airport.947670_RMY.zip")
epwmap = LBEPWmap(epw_map=lb_falsestarttoggle)  # -> report; plug-in component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
uwgsimpar = DFUWGSimulationParameter(veg_par=vegetationpar, epw_site=refepwpar, bnd_layer=boundarylayer)  # -> sim_par; plug-in component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
toggle = BooleanToggle(False)
downloadepw = LBDownloadWeather(weather_URL=panel_5)  # -> epw_file, stat_file, ddy_file; plug-in component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
runuwg = DFRunUrbanWeatherGenerator(model=modeluwg.model, epw_file=downloadepw.epw_file, sim_par=uwgsimpar, write=toggle, run=toggle)  # -> report, uwg_json, urban_epw; plug-in component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
epw = Data(downloadepw.epw_file)

lb_falsestarttoggle_2 = LBFalseStartToggle(False)
syncghfile = LBSyncGrasshopperFile(sync=lb_falsestarttoggle_2)  # -> report; plug-in component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
glazed_part_overhangs = Brep()

# ---- group: case 2
add_partitions = Geometry()

# ----
buildings = Geometry()
trees = Brep()

surroundings = Geometry()
bldg_partitions = Data([glazed_part_overhangs, buildings])

# ----
# 1. Geometry &
# Boundary Conditions
surroundings_2 = Geometry(inspect_building.BuildingMesh)
panel_6 = Panel("""0
45
90
135
180
225
270
315""")
mesh = Mesh(bldg_partitions)
mjoin = MeshJoin(Meshes=flatten(mesh))
abl_flow = ABLFlow(
    WindDirections=panel_6,
    ReferenceVelocityAtZref_m_s=5,
    ReferenceHeight_m=10,
    SurfaceRoughnessHeight_m=Slider(1, range=0..2),
    MinimumZCoordinate_m=0,
    Epw=epw)
tree = Tree(Geo=trees, Type="dense")

number_slider_2 = Slider(500, range=0..1000)
number_slider_3 = Slider(1500, range=0..5000)
number_slider_4 = Slider(32, range=10..50)

preview = CustomPreview(Geometry=mjoin, Material=ColourSwatch(SwatchColor=RGB(255, 255, 255)))
preview_2 = CustomPreview(Geometry=trees, Material=ColourSwatch(SwatchColor=RGB(47, 218, 55)))

panel_7 = Panel("a<-1")
domaincyl = CylindricalDomain(
    Geometry=mjoin,
    Trees=tree,
    BoundaryCondition=abl_flow,
    BlockSize=number_slider_4,
    SizeOfInnerRectangle=Slider(110, range=0..1000),
    SizeOfOuterRadius=number_slider_3,
    Height=number_slider_2)  # -> Domain, Mesh

# ----
# 2. Simulation Domain
cell_size = CellSize(SimulationDomain=domaincyl.Domain, BlockSize=number_slider_4, DesiredCellSize=Slider(2, range=0..10))

# ----
# check the following URL to fix the parallel running problem
# http://bluecfd.github.io/Core/FAQ/mpirun-no-longer-works-in-bluecfd-core-23-1-after-installing-bluecfd-core-2016-1/#solution-1---simply-copy-the-dll-file
button = Button()
panel_8 = Panel("""0
45
90
135
180
225
270
315""")

# ----
# 3. Mesh & Simulation
mset = MeshSettings(
    AccBuilding=cell_size,
    AccFeatures=Slider(5, range=0..10),
    AccBBox=Slider(3, range=0..10),
    AccGround=Slider(2, range=0..10),
    MiscSettings=1,
    NumberOfLayers=4,
    Mode=Slider(1, range=0..2))
rset = RunSettings(
    NumberOfIterations=Slider(1000, range=0..2000),
    WriteInterval=Slider(100, range=0..1000),
    NumberOfTimestepsToKeep=Slider(3, range=0..10),
    TurbulenceModel=3,
    RelaxationFactors=3,
    SolutionAndAlgorithmControl=1,
    PotentialFoamInitialization=False,
    AgeOfAir=False,
    NumberOfCPUs="8",
    OperatingSystem=0)
simulation = Simulation(
    SimulationDomain=domaincyl.Domain,
    WorkingDirectory="C:\Simulation\",
    MeshSettings=mset,
    RunSettings=rset,
    RunMeshing=Button(),
    MakeTrees=Button(),
    RunSimulation=Button(),
    runWithBlueCFD=True)
residuals = VisualizeResiduals(Result=simulation, SelectionOfWindDirections=panel_8, X=":", Y=":", Version=1, Run=button, visResiduals=True)

# ---- group: High value = coarse grid
number_slider_5 = Slider(3, range=1..50)

# ----
brep = Brep([<brep referenced from the Rhino model> x3])
trimmer = Trimmer(A=brep, D="0.5", B=bldg_partitions)
meshplane = MeshPlane(brep=trimmer, number=number_slider_5)  # -> result, result_2
pt = Point(flatten(meshplane.result_2))
# Rerun probing if reopening the file
mesh_join = MeshJoin(Meshes=flatten(meshplane.result))

# ----
# 4. Probing area & probing
panel_9 = Panel("prob_case1")
probing = Probing(Result=simulation, ProbingPoints=pt, NameOfInstance=panel_9, NameOfField=0, Run=Button())  # -> ProbingPoints, ProbingResult

# ---- group: case 2
opaquemat = HBOpaqueMaterial(
    thickness="0.2",
    conductivity="1.73",
    density="2243",
    spec_heat="837",
    therm_absp="0.7",
    sol_absp="0.45",
    vis_absp="0.45")  # -> mat; plug-in component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
opaqueconstr = HBOpaqueConstruction(name="improved_concrete", materials=opaquemat)  # -> constr; plug-in component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

# ----
# Clean
button_2 = Button()
clean = Clean(Directory="C:\Simulation\", Mode=2, Run=button_2)

# ----
# Paraview
button_3 = Button()
paraview = OpenParaview(Result=simulation, ParaviewVersion=2, Run=button_3)

ground_zone = Brep(<brep referenced from the Rhino model>)

tree_canopy = Brep(trees)
soil_zone = Brep(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)
python_2 = GhPythonScript(st_month="5", end_month="11")  # -> values; inputs st_month: Int32, end_month: Int32
# ---------- python_2: Python ----------
from ladybug.analysisperiod import AnalysisPeriod


winter_value = 0.175
summer_value = 0.7
trans_hours = 1000
increment = (winter_value - summer_value) / trans_hours


if st_month and end_month:
    values = [winter_value] * 8760
    a_per = AnalysisPeriod(st_month=st_month, end_month=end_month)
    insert_list = [summer_value] * len(a_per)
    v_i = summer_value
    for i in range(trans_hours):
        insert_list[i] = winter_value - v_i
        insert_list[-i - 1] = winter_value - v_i
        v_i += increment
    values[a_per.st_time.int_hoy - 1:a_per.end_time.int_hoy] = insert_list
# ---------- end python_2 ----------
roomsolid = HBRoomFromSolid(geo=flatten(ground_zone), name="Concrete", conditioned=True)  # -> report, rooms; plug-in component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
roomsolid_2 = HBRoomFromSolid(geo=flatten(soil_zone), name="Soil", conditioned=True)  # -> report, rooms; plug-in component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
fixedintervalschedule = HBFixedIntervalSchedule(values=python_2, name="Deciduous Tree Trans")  # -> report, schedule; plug-in component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
case_1 = Panel("Concrete Pavement")
ground = HBGround(rooms=roomsolid_2.rooms, soil_constr="Grassy Lawn")  # -> rooms; plug-in component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

bounding_box = BoundingBox(Content=tree_canopy, Plane=PlaneXY(0, 0, 0))  # -> Box, Box_2
deconstruct_brep = DeconstructBrep(Brep=bounding_box.Box)  # -> Faces, Edges, Vertices
list_item = ListItem(List=deconstruct_brep.Faces, Index=Slider(5, range=0..6), Wrap=True)  # -> flatten(Item)
points = Data(probing.ProbingPoints)
# 873 pts ~10 min
vectors = Data(probing.ProbingResult)

# ----
# 4.1 Calculate the wind factors
button_4 = Button()
wind_factors = WindFactors(Result=simulation, ProbingPoints=points, WindVelocity=vectors, Run=button_4, Interpolation=False)  # -> WindFactorsSpatial, WindFactorsAnnual

# ----
# 5.5  Set ground zones
ground_2 = HBGround(rooms=roomsolid.rooms, soil_constr=opaqueconstr)  # -> rooms; plug-in component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

# ---- group: case 2
shade = HBShade(geo=bounding_box.Box, ep_trans_sch=fixedintervalschedule.schedule)  # -> report, shades; plug-in component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

# ---- group: wind direction
dir = Slider(2, range=0..7)

# ----
# Visualising the wind directions
cluster = Cluster_3(G=domaincyl.Mesh, A=number_slider_3, relay=number_slider_2, D="90", relay_2=dir)  # -> i_2, G_2, i, C, swatch
previewlw = CustomPreviewLineweights(Geometry=cluster.C, Shader=cluster.swatch, Thickness=Slider(2, range=1..5), Absolute=False)
tag = TextTag3D(Location=cluster.G_2, Text="90", Size=Slider(10, range=1..100), Colour=cluster.swatch, Justification=5)
vdisex = VectorDisplayEx(Point=cluster.i_2, Vector=cluster.i, Colour=RGB(0, 0, 0), Width=Slider(2, range=1..5))

# ---- group: direction for wind factor
# 5. Post-processing
number_slider_6 = Slider(0, range=0..7)

# ----
panel_10 = Panel("-1")

# ----
# 5.1 one or multi - direction Wind factors
dedata = DeconstructDataObjects(Data=wind_factors.WindFactorsSpatial, Select=number_slider_6)
outliers = Outliers(A=dedata)
flip = FlipMatrix(Data=outliers)
panel_11 = Panel("-1000")
avr = Average(Input=flip)  # -> flatten(ArithmeticMean)
Y = UnitY(Factor=1)
move = Move(Motion=Y)  # -> Geometry, Transform
cluster_2 = Cluster_2(C=points, T=Y)
move_2 = Move(Geometry=mjoin, Motion=Y)  # -> Geometry, Transform
legendpar = LBLegendParameters(min=Slider(0, range=0..100), max=Slider(2, range=0..10), num_decimals=1)  # -> leg_par; plug-in component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
createlegend = LBCreateLegend(values=avr, base_plane="500,0,0", title="Average wind factor", legend_par=legendpar)  # -> mesh, title_obj, label_objs, label_text, colors; plug-in component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
swatch = ColourSwatch(SwatchColor=RGBA(255, 255, 255, 120))

colrange = LBColorRange(index=Slider(17, range=0..26))  # -> colors; plug-in component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

# ----
# 5.2 reference wind speeds
choose_dir = TreeBranch(Tree=vectors, Path=dir, MaintainPaths=True)
vlen = VectorLength(Vector=choose_dir)
outliers_2 = Outliers(A=vlen)
panel_12 = Panel("""Velocity, m/s
(Uref = 10 m/s)""")
legendpar_2 = LBLegendParameters(min=Slider(0, range=0..100), max=Slider(14, range=0..100), seg_count=8, colors=colrange, num_decimals=1)  # -> leg_par; plug-in component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
createlegend_2 = LBCreateLegend(values=outliers_2, base_plane="520,0,0", title=panel_12, legend_par=legendpar_2)  # -> mesh, title_obj, label_objs, label_text, colors; plug-in component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
tag_2 = TextTag3D(Location=move.Geometry, Text="Hourly wind speed", Size=Slider(25, range=1..100), Colour=RGB(8, 0, 0), Justification=7)

preview_3 = CustomPreview(Geometry=cluster_2, Material=createlegend.colors)
tag_3 = TextTag3D(Location=move.Geometry, Text="Wind factors", Size=Slider(25, range=1..100), Colour=RGB(8, 0, 0), Justification=7)
preview_4 = CustomPreview(Geometry=move_2.Geometry, Material=swatch)
preview_5 = CustomPreview(
    Geometry=[createlegend.mesh, createlegend.title_obj, createlegend.label_objs],
    Material={diffuse=RGB(221, 160, 221), emission=RGB(66, 48, 66), shine=0.5, specular=RGB(255, 255, 255), transparency=0})

vdisex_2 = VectorDisplayEx(Point=points, Vector=choose_dir, Colour=createlegend_2.colors, Width=Slider(10, range=0..10))
preview_6 = CustomPreview(
    Geometry=[createlegend_2.mesh, createlegend_2.title_obj, createlegend_2.label_objs],
    Material={diffuse=RGB(221, 160, 221), emission=RGB(66, 48, 66), shine=0.5, specular=RGB(255, 255, 255), transparency=0})

number_slider_7 = Slider(12, range=0..23)
number_slider_8 = Slider(5, range=1..12)
number_slider_9 = Slider(14, range=1..31)

panel_13 = Panel("Velocity (Uref = 10 m/s), m/s")
panel_14 = Panel("""Improvement in % 
of hours comfortable""")

# ----
# Climate data visualisation
toggle_2 = BooleanToggle(True)
importepw = LBImportEPW(epw_file=epw)  # -> location, dry_bulb_temperature, dew_point_temperature, relative_humidity, wind_speed, wind_direction, direct_normal_rad, diffuse_horizontal_rad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; plug-in component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
horizinfr = DFHorizontalInfrared(sky_cover=importepw.total_sky_cover, dry_bulb=importepw.dry_bulb_temperature, dew_point=importepw.dew_point_temperature)  # -> horiz_infrared; plug-in component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
outdoorsolarmrt = LBOutdoorSolarMRT(
    location=importepw.location,
    surface_temp=importepw.dry_bulb_temperature,
    dir_norm_rad=importepw.direct_normal_rad,
    diff_horiz_rad=importepw.diffuse_horizontal_rad,
    horiz_infrared=horizinfr,
    run=toggle_2)  # -> report, short_erf, long_erf, short_dmrt, long_dmrt, mrt; plug-in component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
utci = LBUTCIComfort(
    air_temp=importepw.dry_bulb_temperature,
    mrt=outdoorsolarmrt.mrt,
    rel_humid=importepw.relative_humidity,
    wind_vel=importepw.wind_speed,
    run=Toggle(True))  # -> report, utci, comfort, condition, category, comf_obj; plug-in component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
climate_usage_cat = ClimateUsageCat(data=utci.category)  # -> R_2, R, period, usage_category_2
monthlychart = LBMonthlyChart(data=importepw.wind_speed, base_pt="0,1000,0")  # -> report, data_mesh, data_lines, col_lines, legend, borders, labels, y_title, title, vis_set; plug-in component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
panel_15 = Panel(climate_usage_cat.usage_category_2)
panel_16 = Panel(climate_usage_cat.R)
panel_17 = Panel("""summer
autumn
winter
spring
annual""")
windrose = LBWindRose(data=importepw.wind_speed, wind_direction=importepw.wind_direction, center_pt="0,800,0")  # -> report, mesh, compass, orient_line, freq_line, windrose_line, legend, title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; plug-in component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

hourlyplot = LBHourlyPlot(data=importepw.wind_speed, base_pt="0,1200,0")  # -> report, mesh, legend, borders, labels, title, vis_set; plug-in component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

applyper = LBApplyAnalysisPeriod(data=utci.category, period=climate_usage_cat.period)  # -> data; plug-in component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

applyper_2 = LBApplyAnalysisPeriod(data=utci.category, period=climate_usage_cat.period)  # -> data; plug-in component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
list_item_2 = ListItem(List=climate_usage_cat.R, Index=4, Wrap=True)
data = Data(climate_usage_cat.R_2)

hourlyplot_2 = LBHourlyPlot(data=applyper_2, base_pt="0,450,0", statement="-1 <= a <= 2")  # -> report, mesh, legend, borders, labels, title, vis_set; plug-in component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
hourlyplot_3 = LBHourlyPlot(data=applyper, statement="a <-1 or a >2")  # -> report, mesh, legend, borders, labels, title, vis_set; plug-in component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

# ----
# 5.4  Set the analysis period and write wind speeds
# need to write wind speeds only once
# e.g. start hour 8 and end hour 19 means from 8:00 to 20:00
addition = Addition(A="8", B=1)
addition_2 = Addition(A="19", B=1)
analysisperiod = LBAnalysisPeriod(start_month=1, start_day=1, start_hour="8", end_hour="19")  # -> period, hoys, dates; plug-in component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
abins = AnalysisBins(From=1, To=365, Start=addition, End=addition_2)  # -> HOY, DateTime
lng = ListLength(List=analysisperiod.hoys)

# ---- group: Enable to rewrite wind speeds (can take time)
falsestart = LBFalseStartToggle(False)  # disabled
dedata_2 = DeconstructDataObjects(Data=wind_factors.WindFactorsAnnual, Select=abins.HOY)  # disabled

# ----
constrheader = LBConstructHeader(data_type="Fraction", a_period=analysisperiod.period)  # -> header; plug-in component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
dup = DuplicateData(Data="1", Number=lng, Order=True)
data_2 = LBConstructData(header=constrheader, values=dup)  # -> data; plug-in component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

flip_2 = FlipMatrix(Data=dedata_2)

# ----
# 5.6  Calculate UTCI
# you can reload previously calculated UTCI results
panel_18 = Panel("glazed")
opaquemod = HBOpaqueModifier(name="opaque", reflect="0.1")  # -> modifier; plug-in component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
shade_2 = HBShade(geo=bldg_partitions, name="buildings", rad_mod=opaquemod)  # -> report, shades; plug-in component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
sensorgrid = HBSensorGrid(name="grid_1", positions=pt, mesh=mesh_join)  # -> grid; plug-in component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
concat = Concatenate(FragmentA="C:\Simulation\", FragmentB="\UTCImap")
recipesettings = HBRecipeSettings(folder=concat, reload_old=Toggle(True), report_out=Toggle(True))  # -> settings; plug-in component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
falsestart_2 = LBFalseStartToggle(False)

writewind = WriteWindSpeeds(wind_speeds=flip_2, grid_name="grid_1", wind_folder="C:\Simulation\", run=falsestart)  # -> out, wind_folder; inputs wind_speeds: tree, run: Boolean
# ---------- writewind: Python ----------
import os

from honeybee.config import folders
from ladybug_rhino.grasshopper import all_required_inputs, data_tree_to_list


if all_required_inputs(ghenv.Component) and _run:
    # load the data tree to a list of lists
    wind_values = data_tree_to_list(_wind_speeds)

    # setup the location to write the CSV
    #wind_folder = os.path.join(folders.default_simulation_folder, 'utci_wind')
    wind_folder = os.path.join(_wind_folder, 'utci_wind')
    wind_file = os.path.join(wind_folder, '{}.csv'.format(_grid_name))
    if not os.path.isdir(wind_folder):
        os.mkdir(wind_folder)

    # write the CSV file
    with open(wind_file, 'w') as w_file:
        for sensor in wind_values:
            w_file.write(','.join(str(v) for v in sensor[1]) + '\n')

wind_folder = os.path.join(_wind_folder, 'utci_wind')
# ---------- end writewind ----------

# ---- group: Apply schedule to model glazing or trees
constantschedule = HBConstantSchedule(values="0.26", name=panel_18)  # -> report, schedule, idf_text; plug-in component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

# ----
shade_3 = HBShade(geo=[glazed_part_overhangs, list_item], name="glazed partitions", ep_trans_sch=constantschedule.schedule)  # -> report, shades; plug-in component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
model_2 = HBModel(rooms=flatten(ground_2), shades=flatten([shade_2.shades, shade_3.shades]))  # -> report, model; plug-in component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
assigngridsviews = HBAssignGridsAndViews(model=model_2.model, grids=flatten(sensorgrid))  # -> model; plug-in component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
utcimap = HBUTCIComfortMap(
    model=assigngridsviews,
    epw=runuwg.urban_epw,
    north=Slider(0, range=-360..360),
    run_period=analysisperiod.period,
    wind_speed=writewind.wind_folder,
    schedule=data_2,
    run_settings=recipesettings,
    run=falsestart_2)  # -> report, env_conds, utci, condition, category, TCP, HSP, CSP; plug-in component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

# ----
# 5.8  UTCI Usage Category
falsestart_3 = LBFalseStartToggle(False)
thermalmtx = HBReadThermalMatrix(comf_result=utcimap.category, load=falsestart_3)  # -> comf_mtx; plug-in component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
xmatrix = LBDeconstructMatrix(matrix=flatten(thermalmtx))  # -> values; plug-in component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
utci_stats = UTCIStats(data=xmatrix)  # -> R, T
panel_19 = Panel("""All Season
Seasonal
Short-term
Short-term Seasonal
Transient""")
utci_usage = GhPythonScript(stats=utci_stats.T)  # -> flatten(values); inputs stats: list; same code as utci_usage
series = Series(Start="0.1", Step=1, Count="4")
bbox = BoundingBox(Content=mjoin, Plane=PlaneXY(0, 0, 0))  # -> Box, Box_2
entwine = Entwine(
    Branch00=ColourSwatch(SwatchColor=RGB(55, 140, 75)),
    Branch01=ColourSwatch(SwatchColor=RGB(200, 110, 190)),
    Branch02=ColourSwatch(SwatchColor=RGB(30, 255, 255)),
    Branch03=ColourSwatch(SwatchColor=RGB(250, 185, 45)),
    Branch04=ColourSwatch(SwatchColor=RGB(250, 45, 38)),
    FlattenInputs=True)  # -> flatten(Result)
panel_20 = Panel("-3000")
box_corners = BoxCorners(Box=bbox.Box)  # -> CornerA, CornerB, CornerC, CornerD, CornerE, CornerF, CornerG, CornerH
legendparcategorized = LBLegendParametersCategorized(domain=series, colors=entwine, categories=panel_19)  # -> leg_par; plug-in component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
Y_2 = UnitY(Factor=0)
cluster_3 = Cluster_2(C=points, T=Y_2)
move_3 = Move(Geometry=surroundings, Motion=Y_2)  # -> Geometry, Transform
move_4 = Move(Geometry=box_corners.CornerD, Motion=Y_2)  # -> Geometry, Transform
createlegend_3 = LBCreateLegend(values=utci_usage, base_plane="580,0,0", title="Usage Category", legend_par=legendparcategorized)  # -> mesh, title_obj, label_objs, label_text, colors; plug-in component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
preview_7 = CustomPreview(Geometry=cluster_3, Material=createlegend_3.colors)
preview_8 = CustomPreview(Geometry=move_3.Geometry, Material=swatch)
preview_9 = CustomPreview(
    Geometry=[createlegend_3.mesh, createlegend_3.title_obj, createlegend_3.label_objs],
    Material={diffuse=RGB(221, 160, 221), emission=RGB(66, 48, 66), shine=0.5, specular=RGB(255, 255, 255), transparency=0})
tag_4 = TextTag3D(Location=move_4.Geometry, Text="Usage Category", Size=Slider(25, range=1..100), Colour=RGB(8, 0, 0), Justification=7)

# ----
# 5.7  Environmental metrics
# POT. Environmental conditions
# UTCI (feels like) temperature
# Hot / Cold / Neutral
# 11-point UTCI category
# averaged results
# specific hour results
falsestart_4 = LBFalseStartToggle(False)
list = ValueList({"MRT": 0, "Air Temperature": 1, "Longwave MRT": 2, "Shortwave MRT Delta": 3, "Relative Humidity": 4}, selected="MRT")
falsestart_5 = LBFalseStartToggle(False)
falsestart_6 = LBFalseStartToggle(False)
falsestart_7 = LBFalseStartToggle(False)
thermalmtx_2 = HBReadThermalMatrix(comf_result=utcimap.category, load=falsestart_4)  # -> comf_mtx; plug-in component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
thermalmtx_3 = HBReadThermalMatrix(comf_result=utcimap.condition, load=falsestart_5)  # -> comf_mtx; plug-in component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
thermalmtx_4 = HBReadThermalMatrix(comf_result=utcimap.utci, load=falsestart_6)  # -> comf_mtx; plug-in component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
envmtx = HBReadEnvironmentMatrix(env_conds=utcimap.env_conds, metric=list, load=falsestart_7)  # -> comf_mtx; plug-in component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
analysisperiod_2 = LBAnalysisPeriod(
    start_month=Slider(12, range=1..12),
    start_day=1,
    start_hour=Slider(8, range=0..23),
    end_month=Slider(2, range=1..12),
    end_hour=Slider(19, range=0..23))  # -> period, hoys, dates; plug-in component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
analysisperiod_3 = LBAnalysisPeriod(
    start_month=number_slider_8,
    start_day=number_slider_9,
    start_hour=number_slider_7,
    end_month=number_slider_8,
    end_day=number_slider_9,
    end_hour=number_slider_7)  # -> period, hoys, dates; plug-in component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
period = Data(analysisperiod_2.period)
vizthermalmap = HBVisualizeThermalMap(comf_mtx=thermalmtx_3, mesh=flatten(mesh_join), period=period)  # -> report, mesh, legend, title, colors, values; plug-in component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
vizthermalmap_2 = HBVisualizeThermalMap(comf_mtx=thermalmtx_4, mesh=flatten(mesh_join), period=period)  # -> report, mesh, legend, title, colors, values; plug-in component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
vizthermalmap_3 = HBVisualizeThermalMap(comf_mtx=thermalmtx_2, mesh=flatten(mesh_join), period=period)  # -> report, mesh, legend, title, colors, values; plug-in component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
legendpar_3 = LBLegendParameters(min=Slider(24, range=0..100), max=Slider(46, range=0..100), seg_count=Slider(12, range=10..20), num_decimals=1)  # -> leg_par; plug-in component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
vizthermalmap_4 = HBVisualizeThermalMap(comf_mtx=envmtx, mesh=flatten(mesh_join), period=period, legend_par=legendpar_3)  # -> report, mesh, legend, title, colors, values; plug-in component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
panel_21 = Panel("""Daytime Summer
average MRT, °C""")
Y_3 = UnitY(Factor=0)
createlegend_4 = LBCreateLegend(values=vizthermalmap_4.values, base_plane="520,0,0", title=panel_21, legend_par=legendpar_3)  # -> mesh, title_obj, label_objs, label_text, colors; plug-in component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
cluster_4 = Cluster_2(C=points, T=Y_3)
preview_10 = CustomPreview(Geometry=cluster_4, Material=createlegend_4.colors)
preview_11 = CustomPreview(
    Geometry=[createlegend_4.mesh, createlegend_4.title_obj, createlegend_4.label_objs],
    Material={diffuse=RGB(221, 160, 221), emission=RGB(66, 48, 66), shine=0.5, specular=RGB(255, 255, 255), transparency=0})

# ----
# Visualize Heat and Cold Sensation
panel_22 = Panel("""10
11""")
colrange_2 = LBColorRange(index=panel_22)  # -> colors; plug-in component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
mjoin_2 = MeshJoin(Meshes=mesh_join)
legendpar_4 = LBLegendParameters(colors=colrange_2)  # -> leg_par; plug-in component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
move_5 = Move(Geometry=mjoin_2, Motion="0,300,0")  # -> Geometry, Transform
move_6 = Move(Motion="0,300,0")  # -> Geometry, Transform
bang = ExplodeTree(Data=simplify(legendpar_4))  # -> Branch0, Branch1
heatmap = LBSpatialHeatmap(values=utcimap.CSP, mesh=move_5.Geometry, legend_par=bang.Branch1, legend_title="%")  # -> mesh, legend, title, colors, legend_par, vis_set; plug-in component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
heatmap_2 = LBSpatialHeatmap(values=utcimap.HSP, mesh=mjoin_2, legend_par=bang.Branch0, legend_title="%")  # -> mesh, legend, title, colors, legend_par, vis_set; plug-in component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

preview_12 = CustomPreview(
    Geometry=vizthermalmap_4.mesh,
    Material={diffuse=RGB(221, 160, 221), emission=RGB(66, 48, 66), shine=0.5, specular=RGB(255, 255, 255), transparency=0})
cluster_5 = Cluster_2(C=points, T=Y_2)

# ----
# 5.3 Hourly wind speed
number_slider_10 = Slider(4258, range=0..8759)
panel_23 = Panel("-1500")
Y_4 = UnitY(Factor=1)
move_7 = Move(Geometry=mjoin, Motion=Y_4)  # -> Geometry, Transform
cluster_6 = Cluster_2(C=points, T=Y_4)
move_8 = Move(Motion=Y_4)  # -> Geometry, Transform
legendpar_5 = LBLegendParameters(min=Slider(0, range=0..100), max=Slider(7, range=0..100), num_decimals=1)  # -> leg_par; plug-in component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
tag_5 = TextTag3D(Location=move_8.Geometry, Text="Hourly wind speed", Size=Slider(25, range=1..100), Colour=RGB(8, 0, 0), Justification=7)

dedata_3 = DeconstructDataObjects(Data=wind_factors.WindFactorsAnnual, Select=number_slider_10)

outliers_3 = Outliers(A=dedata_3)
flip_3 = FlipMatrix(Data=outliers_3)
data_3 = Data(flatten(flip_3))
createlegend_5 = LBCreateLegend(values=data_3, base_plane="530,0,0", title="Velocity (hourly), m/s", legend_par=legendpar_5)  # -> mesh, title_obj, label_objs, label_text, colors; plug-in component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

cluster_7 = Cluster_4(G=domaincyl.Mesh, T=Y_4, A=number_slider_3, data=importepw.wind_direction, i=number_slider_10)  # -> G_2, V
vdisex_3 = VectorDisplayEx(Point=cluster_7.G_2, Vector=cluster_7.V, Colour=RGB(0, 0, 0), Width=2)

preview_13 = CustomPreview(Geometry=cluster_6, Material=createlegend_5.colors)
preview_14 = CustomPreview(Geometry=move_7.Geometry, Material=swatch)
preview_15 = CustomPreview(
    Geometry=[createlegend_5.mesh, createlegend_5.title_obj, createlegend_5.label_objs],
    Material={diffuse=RGB(221, 160, 221), emission=RGB(66, 48, 66), shine=0.5, specular=RGB(255, 255, 255), transparency=0})

# ----
# 5.9  Microclimate Positive
list_item_3 = ListItem(List=utci_stats.T, Index=4, Wrap=True)
entwine_2 = Entwine(
    Branch00=ColourSwatch(SwatchColor=RGB(250, 45, 38)),
    Branch01=ColourSwatch(SwatchColor=RGB(255, 255, 255)),
    Branch02=ColourSwatch(SwatchColor=RGB(55, 140, 75)),
    FlattenInputs=True)  # -> flatten(Result)
legendpar_6 = LBLegendParameters(min="-20", max="20", seg_count="17", colors=entwine_2, num_decimals=1, text_height=Slider(0.5, range=0.5..2))  # -> leg_par; plug-in component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
mjoin_3 = MeshJoin(Meshes=mesh_join)
subtraction = Subtraction(A=utci_stats.R, B=data)  # -> flatten(Result)

multiplication = Multiplication(A=subtraction, B=100)

createlegend_6 = LBCreateLegend(values=multiplication, base_plane="520,0,0", title=panel_14, legend_par=legendpar_6)  # -> mesh, title_obj, label_objs, label_text, colors; plug-in component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
heatmap_3 = LBSpatialHeatmap(values=multiplication, mesh=mjoin_3, legend_par=legendpar_6, legend_title="%")  # -> mesh, legend, title, colors, legend_par, vis_set; plug-in component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
preview_16 = CustomPreview(
    Geometry=[createlegend_6.mesh, createlegend_6.title_obj, createlegend_6.label_objs],
    Material={diffuse=RGB(221, 160, 221), emission=RGB(66, 48, 66), shine=0.5, specular=RGB(255, 255, 255), transparency=0})
preview_17 = CustomPreview(
    Geometry=heatmap_3.mesh,
    Material={diffuse=RGB(221, 160, 221), emission=RGB(66, 48, 66), shine=0.5, specular=RGB(255, 255, 255), transparency=0})
preview_18 = CustomPreview(Geometry=cluster_5, Material=createlegend_6.colors)

# ==== cluster Outliers
A = ClusterInput()
larger = LargerThan(FirstNumber=A, SecondNumber="80")  # -> LargerThan, OrEqualTo
dispatch = Dispatch(List=A, DispatchPattern=larger.LargerThan)  # -> ListA, ListB
index = ItemIndex(List=A, Item=dispatch.ListA)
num = Number("0")
replace = ReplaceItems(List=A, Item=num, Indices=index, Wrap=False)
L = ClusterOutput(replace)

# ==== cluster Cluster_2
C = ClusterInput()
T = ClusterInput()
cluster = Cluster(C=C)
move = Move(Geometry=cluster, Motion=T)  # -> Geometry, Transform
G = ClusterOutput(move.Geometry)

# ==== cluster Cluster_3
G = ClusterInput()
A = ClusterInput()
relay = ClusterInput()
D = ClusterInput()
relay_2 = ClusterInput()

area = Area(Geometry=G)  # -> Area, Centroid
division = Division(A=A, B=2)
addition = Addition(A=division, B=20)
project = Project(Geometry=area.Centroid, Plane=PlaneXY(0, 0, 0))  # -> Geometry, Transform
Y = UnitY(Factor=addition)
cyl = Cylinder(Base=project.Geometry, Radius=division, Length=relay)
rad = Radians(Degrees=D)
move = Move(Geometry=project.Geometry, Motion=Y)  # -> Geometry, Transform
xz = XZPlane(Origin=project.Geometry)
neg = Negative(Value=rad)
rot3d = Rotate3D(Geometry=xz, Angle=neg, Center=project.Geometry, Axis=Vector(0, 0, 1))  # -> Geometry, Transform
rotate = Rotate(Geometry=move.Geometry, Angle=neg, Plane=project.Geometry)  # -> Geometry, Transform
ln = Line(StartPoint=project.Geometry, EndPoint=rotate.Geometry)
vec2pt = Vector2Pt(PointA=rotate.Geometry, PointB=project.Geometry, Unitize=False)  # -> Vector, Length
neg_2 = Negative(Value=division)
amp = Amplitude(Vector=vec2pt.Vector, Amplitude=Slider(40, range=1..200))
dom = ConstructDomain(DomainStart=division, DomainEnd=neg_2)
dom_2 = ConstructDomain(DomainStart=0, DomainEnd=relay)
unit = UnitVector(Vector=vec2pt.Vector)
item = ListItem(List=amp, Index=relay_2, Wrap=True)
planesrf = PlaneSurface(Plane=rot3d.Geometry, XSize=dom, YSize=dom_2)
split = SplitBrep(Brep=cyl, Cutter=planesrf)  # -> simplify(Result)
item_2 = ListItem(List=split, Index=1, Wrap=True)
project_2 = Project(Geometry=item_2, Plane=PlaneXY(0, 0, 0))  # -> Geometry, Transform
clx = CurveLine(Curve=flatten(project_2.Geometry), Line=ln)  # -> Points, Params, Count
item_3 = ListItem(List=clx.Points, Index=0, Wrap=True)  # -> flatten(Item)
branch = TreeBranch(Tree=item_2, Path=relay_2, MaintainPaths=True)
sec = BrepPlane(Brep=branch, Plane=PlaneXY(0, 0, 0))  # -> Curves, Points

G_2 = ClusterOutput(rotate.Geometry)
i = ClusterOutput(item)
i_2 = ClusterOutput(item_3)
C = ClusterOutput(sec.Curves)
swatch = ClusterOutput(ColourSwatch(SwatchColor=RGB(0, 0, 0)))

# ==== cluster Cluster_4
data = ClusterInput()
xdata = LBDeconstructData(data=data)  # -> header, values; plug-in component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
G = ClusterInput()
A = ClusterInput()
i = ClusterInput()
area = Area(Geometry=G)  # -> Area, Centroid
T = ClusterInput()
division = Division(A=A, B=2)
item = ListItem(List=xdata.values, Index=i, Wrap=True)
move = Move(Geometry=area.Centroid, Motion=T)  # -> Geometry, Transform
Y = UnitY(Factor=division)
project = Project(Geometry=move.Geometry, Plane=PlaneXY(0, 0, 0))  # -> Geometry, Transform
rad = Radians(Degrees=item)
move_2 = Move(Geometry=project.Geometry, Motion=Y)  # -> Geometry, Transform
G_2 = ClusterOutput(move_2.Geometry)
Z = UnitZ(Factor=1)
vec2pt = Vector2Pt(PointA=move_2.Geometry, PointB=project.Geometry, Unitize=False)  # -> Vector, Length
vrot = Rotate(Vector=vec2pt.Vector, Axis=Z, Angle=rad)
amp = Amplitude(Vector=vrot, Amplitude=Slider(50, range=20..100))
V = ClusterOutput(amp)

# ==== cluster MeshPlane
number = ClusterInput()
brep = ClusterInput()
number_slider = Slider(150, range=0..400)
number_2 = Number(number)
division = Division(A=number_2, B=Slider(3, range=0..3))
# three options for meshing are used: mesh brep; triangulate and quad remesh. The latter two are used here. Verify the meshing results with Deconstruct mesh, select appropriate and adjust branching accordingly
number_slider_2 = Slider(100, range=1..100)
area = Area(Geometry=brep)  # -> Area, Centroid
settings_custom = SettingsCustom(
    StitchSeams=True,
    SimplePlanes=False,
    Refine=True,
    MinCount=16,
    MaxCount=400,
    AspectRatio=Slider(0, range=0..20),
    MaxDistance=0,
    MaxAngle=20,
    MinEdge=division,
    MaxEdge=number_2)
mesh_brep = MeshBrep(Brep=brep, Settings=settings_custom)
quad_remesh_settings = QuadRemeshSettings(
    TargetCount=[Slider(46, range=0..100), Slider(28, range=0..100)],
    AdaptiveSize=0,
    AdaptiveCount=False,
    HardEdges=False,
    SeamEdges=0,
    Symmetry=0,
    GuideCurves=0)
triremesh = TriRemesh(Geometry=brep, Sharp=False, Length=Slider(4, range=0.1..5), Iterations=number_slider_2)  # -> Triangulation, Dual, Creases
panel = Panel(area.Area)
deconstruct_mesh = DeconstructMesh(Mesh=mesh_brep)  # -> Vertices, Faces, Colours, Normals
dispatch = Dispatch(List=flatten(triremesh.Triangulation), DispatchPattern=[True, False, False])  # -> ListA, ListB
quad_remesh = QuadRemesh(Mesh=dispatch.ListB, Settings=quad_remesh_settings)
deconstruct_mesh_2 = DeconstructMesh(Mesh=dispatch.ListA)  # -> Vertices, Faces, Colours, Normals
deconstruct_mesh_3 = DeconstructMesh(Mesh=quad_remesh)  # -> Vertices, Faces, Colours, Normals
explode_tree = ExplodeTree(Data=deconstruct_mesh_3.Vertices)  # -> Branch0, Branch1
merge_mesh = Merge(Data1=dispatch.ListA, Data2=quad_remesh)
entwine = Entwine(Branch00=deconstruct_mesh_2.Vertices, Branch01=explode_tree.Branch0, Branch02=explode_tree.Branch1, FlattenInputs=True)  # -> simplify(Result)
result = ClusterOutput(merge_mesh)
result_2 = ClusterOutput(entwine)

# ==== cluster Trimmer
A = ClusterInput()
B = ClusterInput()
bbx = BrepBrep(BrepA=A, BrepB=B)  # -> Curves, Points
D = ClusterInput()
offset_l = OffsetCurveLoose(Curve=bbx.Curves, Distance=D)
Z = UnitZ(Factor=1)
boundary = BoundarySurfaces(Edges=offset_l)
extr = Extrude(Base=boundary, Direction=Z)
trim = TrimSolid(Shape=A, Cutters=flatten(extr))
R = ClusterOutput(trim)

# ==== cluster UTCIStats
number_slider = Slider(8, range=0..23)
number_slider_2 = Slider(19, range=0..23)
analysisperiod = LBAnalysisPeriod(start_month=1, start_day=1, start_hour=number_slider, end_hour=number_slider_2)  # -> period, hoys, dates; plug-in component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
analysisperiod_2 = LBAnalysisPeriod(
    start_month=[Slider(12, range=0..12), Slider(3, range=0..12), Slider(6, range=0..12), Slider(9, range=0..12)],
    start_day=1,
    start_hour=number_slider,
    end_month=[Slider(2, range=0..12), Slider(5, range=0..12), Slider(8, range=0..12), Slider(11, range=0..12)],
    end_hour=number_slider_2)  # -> period, hoys, dates; plug-in component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
data = ClusterInput()
applyper = LBApplyAnalysisPeriod(data=graft(data), period=[analysisperiod_2.period, analysisperiod.period])  # -> data; plug-in component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
applyper_2 = LBApplyAnalysisPeriod(data=data, period=analysisperiod.period)  # -> data; plug-in component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
xdata = LBDeconstructData(data=applyper)  # -> header, values; plug-in component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
xdata_2 = LBDeconstructData(data=applyper_2)  # -> header, values; plug-in component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
lng = ListLength(List=xdata.values)
lng_2 = ListLength(List=xdata_2.values)
smaller = SmallerThan(FirstNumber=xdata.values, SecondNumber=Slider(2, range=0..5))  # -> SmallerThan, OrEqualTo
smaller_2 = SmallerThan(FirstNumber=xdata_2.values, SecondNumber=Slider(0, range=0..5))  # -> SmallerThan, OrEqualTo
larger = LargerThan(FirstNumber=xdata.values, SecondNumber=Slider(-1, range=-5..0))  # -> LargerThan, OrEqualTo
larger_2 = LargerThan(FirstNumber=xdata_2.values, SecondNumber=Slider(0, range=-5..0))  # -> LargerThan, OrEqualTo
and = GateAnd(A=larger.OrEqualTo, B=smaller.OrEqualTo)
and_2 = GateAnd(A=larger_2.OrEqualTo, B=smaller_2.OrEqualTo)
ma = MassAddition(Input=and)  # -> Result, PartialResults
ma_2 = MassAddition(Input=and_2)  # -> Result, PartialResults
division = Division(A=ma.Result, B=lng)  # -> simplify(Result)
division_2 = Division(A=ma_2.Result, B=lng_2)  # -> simplify(Result)
trim = TrimTree(Tree=division, Depth=1)
R = ClusterOutput(division_2)
T = ClusterOutput(trim)

# ==== cluster ClimateUsageCat
number_slider = Slider(8, range=0..23)
number_slider_2 = Slider(19, range=0..23)
analysisperiod = LBAnalysisPeriod(
    start_month=[Slider(12, range=0..12), Slider(3, range=0..12), Slider(6, range=0..12), Slider(9, range=0..12)],
    start_day=1,
    start_hour=number_slider,
    end_month=[Slider(2, range=0..12), Slider(5, range=0..12), Slider(8, range=0..12), Slider(11, range=0..12)],
    end_hour=number_slider_2)  # -> period, hoys, dates; plug-in component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
analysisperiod_2 = LBAnalysisPeriod(start_month=1, start_day=1, start_hour=number_slider, end_hour=number_slider_2)  # -> period, hoys, dates; plug-in component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
data = ClusterInput()
period = ClusterOutput(analysisperiod_2.period)
applyper = LBApplyAnalysisPeriod(data=data, period=[analysisperiod.period, analysisperiod_2.period])  # -> data; plug-in component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
applyper_2 = LBApplyAnalysisPeriod(data=data, period=analysisperiod_2.period)  # -> data; plug-in component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
xdata = LBDeconstructData(data=applyper)  # -> header, values; plug-in component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
xdata_2 = LBDeconstructData(data=applyper_2)  # -> header, values; plug-in component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
lng = ListLength(List=xdata.values)
smaller = SmallerThan(FirstNumber=xdata.values, SecondNumber=Slider(2, range=0..5))  # -> SmallerThan, OrEqualTo
larger = LargerThan(FirstNumber=xdata.values, SecondNumber=Slider(-1, range=-5..0))  # -> LargerThan, OrEqualTo
lng_2 = ListLength(List=xdata_2.values)
smaller_2 = SmallerThan(FirstNumber=xdata_2.values, SecondNumber=Slider(0, range=0..5))  # -> SmallerThan, OrEqualTo
larger_2 = LargerThan(FirstNumber=xdata_2.values, SecondNumber=Slider(0, range=-5..0))  # -> LargerThan, OrEqualTo
and = GateAnd(A=larger.OrEqualTo, B=smaller.OrEqualTo)
and_2 = GateAnd(A=larger_2.OrEqualTo, B=smaller_2.OrEqualTo)
ma = MassAddition(Input=and)  # -> Result, PartialResults
ma_2 = MassAddition(Input=and_2)  # -> Result, PartialResults
division = Division(A=ma.Result, B=lng)  # -> flatten(Result)
division_2 = Division(A=ma_2.Result, B=lng_2)  # -> flatten(Result)
utci_usage = GhPythonScript(stats=flatten(division))  # -> flatten(values); inputs stats: list
# ---------- utci_usage: Python ----------
""" Disclaimer: This source code has been prepared for a specific purpose and should not be relied upon or used for any other purpose
 without an independent check being carried out as to its suitability and prior written authority of Mott MacDonald being
 obtained.  Mott MacDonald accepts no responsibility or liability for the consequence of this code being used for a purpose
 other than the purposes for which it was commissioned. Any person using or relying on the code for such other purpose
 agrees, and will by such use or reliance be taken to confirm his agreement to indemnify Mott MacDonald for all loss or
 damage resulting therefrom. Mott MacDonald accepts no responsibility or liability for this code to any party other than the
 person by whom it was commissioned.

(c) Mott MacDonald

-----------------------------------------------------------------------------------
    Describe your Inputs (adjust name of variables to suit your script):
        
    x: The x script variable
    y: The y script variable

    Describe your Output (adjust name of variables to suit your script):
        a: The a output variable
        
    Please comment your scripts adding in clear notes which explain the purpose of functions throughout the script
    
        """

__author__ = "IVA95817"
__version__ = "2022.02.07"

print(stats[0])

#for i in range(stats:
if stats[0]>0.9 and stats[1]>=0.9 and stats[2]>=0.9 and stats[3]>=0.9: 
    values = 0 # All season category. ≥90% in each season. Appropriate for use year-round (e.g. parks).
elif stats[0]>0.9 and stats[1]>=0.9 and stats[2]>=0.7 and stats[3]>=0.9: 
    values = 1 # Seasonal category. ≥90% spring-autumn AND ≥70% winter. Appropriate for use during most of the year (e.g. outdoor dining).
elif stats[0]>0.5 and stats[1]>=0.5 and stats[2]>=0.5 and stats[3]>=0.5: 
    values = 2 # Short-term category. ≥50% in each season.  Appropriate for short duration and/or infrequent sedentary uses (e.g. unsheltered bus stops or entrances) year-round.
elif stats[0]>0.5 and stats[1]>=0.5 and stats[2]>=0.25 and stats[3]>=0.5: 
    values = 3 # Short-term seasonal category. ≥50% spring-autumn AND ≥25% winter. Appropriate for short duration and/or infrequent sedentary uses during most of the year.
elif stats[0]<0.5 or stats[1]<0.5 or stats[3]<0.5 or stats[2]<0.25: 
    values = 4 # Transient category. <25% in winter OR <50% in any other season. Appropriate for public spaces where people are not expected to linger for extended period (e.g. pavements, cycle paths).
# ---------- end utci_usage ----------
panel = Panel("""All Season
Seasonal
Short-term
Short-term Seasonal
Transient""")
R = ClusterOutput(division)
R_2 = ClusterOutput(division_2)
item = ListItem(List=panel, Index=utci_usage, Wrap=True)
usage_category = Data(item)
usage_category_2 = ClusterOutput(usage_category)

# ==== cluster Cluster
C = ClusterInput()
circle = CircleCNR(Center=C, Normal=Vector(0, 0, 1), Radius=1.5)
srf = Surface(circle)
srf_2 = ClusterOutput(srf)
